# Dynamo graph Group Model Duplicator.dyn (Dynamo 2.13.1.3887)

# note: Copy = True
# Delete = False
copy_delete = BoolSelector(false)
proceed = BoolSelector(true)
target_plans_ceiling = CodeBlock()
# ---------- target_plans_ceiling.designscript (32 lines) ----------
base_target = "2442306";
 // LEVEL 4A;

targets = [
	"2442315", // LEVEL 5A
	"2442324", // LEVEL 6A
	"2442333", // LEVEL 7A
	"2442342", // LEVEL 8A
	"2442351", // LEVEL 9A
	"2442360", // LEVEL 10A
	"2442369", // LEVEL 11A
	"2442378", // LEVEL 12A
	"2442387", // LEVEL 13A
	"2442396", // LEVEL 14A
	"2442405", // LEVEL 15A
	"2442414", // LEVEL 16A
	"2442423", // LEVEL 17A
	"2442432", // LEVEL 18A
	"2442441", // LEVEL 19A
	"2442450", // LEVEL 20A
	"2442459", // LEVEL 21A
	"2442468", // LEVEL 22A
	"2442477", // LEVEL 23A
	"2442486", // LEVEL 24A
	"2442495", // LEVEL 25A
	"2442504", // LEVEL 26A
	"2442513", // LEVEL 27A
	"2442522", // LEVEL 28A
	"2442531", // LEVEL 29A
	"2442540", // LEVEL 30A
	"2442549" // LEVEL 31A
];
# ----------------------------------------
options = CodeBlock()
# ---------- options.designscript (3 lines) ----------
[
	true	// Rename panels?
];
# ----------------------------------------
plan_copy_py = Python(IN[0]=copy_delete, IN[1]=proceed, IN[2]=target_plans_ceiling.base_target, IN[3]=target_plans_ceiling.targets, IN[4]=options)  # CPython3
# ---------- plan_copy_py.python (156 lines) ----------
import clr
import math
from io import StringIO

import Autodesk
import RevitServices
from Autodesk.Revit.DB import *
from Autodesk.Revit.DB import FilteredElementCollector, IndependentTag,BuiltInParameter, BuiltInCategory, ElementTransformUtils, FamilyInstance

from RevitServices.Persistence import DocumentManager
from RevitServices.Transactions import TransactionManager
from Autodesk.Revit.DB import Dimension, Line, XYZ, Group, ElementId, Electrical

clr.AddReference('System')
from System.Collections.Generic import List

clr.AddReference("RevitAPI")
clr.AddReference("RevitServices")


# For Outputting print to watch node
output = StringIO()
sys.stdout = output

doc = DocumentManager.Instance.CurrentDBDocument
active_view = doc.ActiveView

def transaction(func):
    def wrapper(*args, **kwargs):
            TransactionManager.Instance.EnsureInTransaction(doc)
            func(*args, **kwargs)
            TransactionManager.Instance.TransactionTaskDone()
    return wrapper

def print_member(obj):
  for i in dir(obj):
      print(i)

def get_element(id_str):
  return doc.GetElement(ElementId(id_str))

def copy_to_plan(base_plan, t_plan, collection_elements, options_dict):

  # Copy the Elemetns
  copied_ids = ElementTransformUtils.CopyElements(base_plan, collection_elements, t_plan, Transform.Identity, CopyPasteOptions())
  copied_elements = [doc.GetElement(cid) for cid in copied_ids]
  
  for celem in copied_elements:
    if isinstance(celem, FamilyInstance): 
      
      parameter = celem.LookupParameter("Schedule Level")
      if parameter and not parameter.IsReadOnly:
        parameter.Set(t_plan.GenLevel.Id)

    # Panel reName
    if options_dict["prename"] == true:
      if isinstance(celem, FamilyInstance) and celem.Category.Id.IntegerValue == int(BuiltInCategory.OST_ElectricalEquipment):
        print(celem.Name, type(celem))

        param_panel = celem.LookupParameter("Comments")
        param_panel_value = param_panel.AsValueString()
        if param_panel_value == "Panel":
          param_panel_name = celem.LookupParameter("Panel Name")
          raw_name = param_panel_name.AsValueString().strip().split(" ", 1) #    ["A2", "[Unit 401]"]
          real_pname = raw_name[0]                               #     "A2"
          unit_no = raw_name[1].replace("]", "").replace("[", "").split(" ")[1].replace("4", "", 1) #     "01"
          
          floor_no = t_plan.Name.replace("LEVEL", "").strip()[0:-1]
          final_name = f'{real_pname} [UNIT {floor_no}{unit_no}]'
          print("St: ", final_name)
          param_panel_name.Set(final_name)

          celem.LookupParameter("Mark").Set(real_pname)


  group = doc.Create.NewGroup(List[ElementId](copied_ids))
  group.GroupType.Name = f"{t_plan.Name} Models"


def delete_group_plan(t_plan):
  elems = FilteredElementCollector(doc, t_plan.Id).OfCategory(BuiltInCategory.OST_IOSModelGroups).ToElements()
  group_types = []
  for grp in elems:
    group_types.append(grp.GroupType)
    doc.Delete(grp.Id)
  
  for e in group_types:
    doc.Delete(e.Id)

def get_options(options):
  diction = {}
  diction["prename"] = options[0]
  return diction

mode = UnwrapElement(IN[0])
proceed = UnwrapElement(IN[1])
base_plan_id = UnwrapElement(IN[2])
target_plans = UnwrapElement(IN[3])
options = UnwrapElement(IN[4])

# 2680980

exception_categories = [
  int(BuiltInCategory.OST_RvtLinks),
  int(BuiltInCategory.OST_Grids),
  int(BuiltInCategory.OST_SectionBox),
  int(BuiltInCategory.OST_Cameras),
  int(BuiltInCategory.OST_Elev),
  int(BuiltInCategory.OST_Viewers),
  int(BuiltInCategory.OST_Viewers),
  int(BuiltInCategory.OST_IOSModelGroups)
]

@transaction 
def start():
  print("Current Mode: ", mode)
  base_plan = get_element(base_plan_id)
  target_plans_elems = [get_element(e) for e in target_plans]
  options_dict = get_options(options)

  # Delete
  if mode == False:
    for tar_plan in target_plans_elems:
      delete_group_plan(tar_plan)

  # Copy
  elif mode == True:
    # Get All elements in base view plan
    elements_source = FilteredElementCollector(doc, base_plan.Id).WhereElementIsNotElementType().ToElements()
    filtered_elements = []

    # Filter Elements
    for e in elements_source:
      category = e.Category

      if not category or (category and category.Id.IntegerValue in exception_categories):
        continue

      filtered_elements.append(e.Id)


    # Creat c# compatible list
    collection = List[ElementId](filtered_elements)

    # apply copy to every target plan
    for tar_plan in target_plans_elems:
      copy_to_plan(base_plan, tar_plan, collection, options_dict)


if proceed:
  print("Starting Script")
  start()
else:
  print("Script not enabled")

OUT = output.getvalue()
# ----------------------------------------
watch = Watch(plan_copy_py)
which_to_print = CodeBlock { "Level"; "Plan"; }
view_plan = CodeBlock()
# ---------- view_plan.designscript (6 lines) ----------
// View Type
"Floor Plan";
"Ceiling Plan";

// Discipline
"Electrical";
# ----------------------------------------

# group: Get All Elements
categories = Categories("OST_Views")
all_elements_of_category = ElementsOfCategory(Category=categories)
code_block = CodeBlock { false; }
clean = List.Clean(list=all_elements_of_category, preserveIndices=code_block)

level_printer_py = Python(IN[0]=which_to_print.out1, IN[1]=view_plan.out1, IN[2]=view_plan.out2, IN[3]=clean)  # CPython3
# ---------- level_printer_py.python (95 lines) ----------
import clr
import math
from io import StringIO

import Autodesk
import RevitServices
from Autodesk.Revit.DB import *
from Autodesk.Revit.DB import ViewType
from Autodesk.Revit.DB import FilteredElementCollector, Dimension

from RevitServices.Persistence import DocumentManager
from RevitServices.Transactions import TransactionManager
from Autodesk.Revit.DB import Dimension, Line, XYZ, Level

clr.AddReference("RevitAPI")
clr.AddReference("RevitServices")


# For Outputting print to watch node
output = StringIO()
sys.stdout = output
result = []
doc = DocumentManager.Instance.CurrentDBDocument

def transaction(func):
    def wrapper(*args, **kwargs):
            TransactionManager.Instance.EnsureInTransaction(doc)
            func(*args, **kwargs)
            TransactionManager.Instance.TransactionTaskDone()
    return wrapper
 
def print_member(obj):
  for i in dir(obj):
      print(i)

def get_element_via_parameter(elements, parameter_name, parameter_value):
    result = []
    for el in elements:
        param_ViewType = el.GetParameters(parameter_name)[0]
        if param_ViewType.AsValueString() == parameter_value:
            result.append(el)
            continue
    return result


def get_all_view_type(elements, view_type):
    result = []
    for el in elements:
        if el.ViewType == view_type:
            result.append(el)
    return result

plan_dict = {
    "Floor Plan": ViewType.FloorPlan,
    "Ceiling Plan": ViewType.CeilingPlan
}

family_dict = {
    "Floor Plan": ViewFamily.FloorPlan,
    "Ceiling Plan": ViewFamily.CeilingPlan
}

to_print = UnwrapElement(IN[0])
view_plan = UnwrapElement(IN[1])
discipline = UnwrapElement(IN[2])
elements = UnwrapElement(IN[3])

@transaction
def start():
  target_levels = UnwrapElement(IN[0])

  print(f"To print: {to_print} {view_plan}\n")
  if to_print == "Level":
    # Get all levels in the document
    collector = FilteredElementCollector(doc).OfClass(Level)
    levels = collector.ToElements()

    # Create a list of level names
    for level in levels:
      print(f'"{level.Id.ToString()}", // {level.Name}')

  # Print all plan
  elif to_print == "Plan":
    discipline_type = discipline
    plan_type = view_plan
    elem_discipline = get_element_via_parameter(elements, "Discipline", discipline_type)
    elem_plan = get_all_view_type(elem_discipline, plan_dict[plan_type])
    for plan in elem_plan:
      print(f'"{plan.Id}", // {plan.Name}')


start()

OUT = result
OUT = output.getvalue()
# ----------------------------------------
watch_2 = Watch(level_printer_py)
