# Dynamo graph Level Copy.dyn (Dynamo 2.13.1.3887)

all_elements_at_level = ElementsAtLevel()  # unwired: Level
python_script = Python(IN[0]=all_elements_at_level)  # CPython3
# ---------- python_script.python (47 lines) ----------
import clr
import math
from io import StringIO

import Autodesk
import RevitServices
from Autodesk.Revit.DB import *
from Autodesk.Revit.DB import FilteredElementCollector, Dimension

from RevitServices.Persistence import DocumentManager
from RevitServices.Transactions import TransactionManager
from Autodesk.Revit.DB import Dimension, Line, XYZ

clr.AddReference("RevitAPI")
clr.AddReference("RevitServices")


# For Outputting print to watch node
output = StringIO()
sys.stdout = output

doc = DocumentManager.Instance.CurrentDBDocument

def transaction(func):
    def wrapper(*args, **kwargs):
            TransactionManager.Instance.EnsureInTransaction(doc)
            func(*args, **kwargs)
            TransactionManager.Instance.TransactionTaskDone()
    return wrapper
 
def print_member(obj):
  for i in dir(obj):
      print(i)

@transaction
def start(model):
  groups = UnwrapElement(model)
  elements = groups[0].GetMemberIds()
  elements_id = [doc.GetElement(e) for e in elements]
  for i in elements_id:
    print(i.Name)



start(IN[0])

OUT = output.getvalue()
# ----------------------------------------
watch = Watch(python_script)
levels = Levels("1st Floor")
code_block = CodeBlock()
# ---------- code_block.designscript (9 lines) ----------
levels = [

"694", // 2nd Floor
"1345358", // 5th Floor
"1345666", // 4th Floor
"1345676", // Roof Deck
"1345678" // 3rd Floor

];
# ----------------------------------------
python_script_2 = Python(IN[0]=levels, IN[1]=code_block)  # CPython3
# ---------- python_script_2.python (73 lines) ----------
import clr
import math
from io import StringIO

import Autodesk
import RevitServices
from Autodesk.Revit.DB import *
from Autodesk.Revit.DB import FilteredElementCollector, Dimension

from RevitServices.Persistence import DocumentManager
from RevitServices.Transactions import TransactionManager
from Autodesk.Revit.DB import Dimension, Line, XYZ

clr.AddReference("RevitAPI")
clr.AddReference("RevitServices")


# For Outputting print to watch node
output = StringIO()
sys.stdout = output

doc = DocumentManager.Instance.CurrentDBDocument

def transaction(func):
    def wrapper(*args, **kwargs):
            TransactionManager.Instance.EnsureInTransaction(doc)
            func(*args, **kwargs)
            TransactionManager.Instance.TransactionTaskDone()
    return wrapper
 
def print_member(obj):
  for i in dir(obj):
      print(i)


def  level_printer():
  # Get all levels in the document
  collector = FilteredElementCollector(doc).OfClass(Level)
  levels = collector.ToElements()

  for level in levels:
      lvl_name = level.Name
      lvl_id = level.Id.ToString()
      print(f'"{lvl_id}" # {lvl_name}, ')

def  level_sort(target_levels):
  # Get all levels in the document
  collector = FilteredElementCollector(doc).OfClass(Level)
  levels = collector.ToElements()

  # Create a list of level names
  level_names = []
  for level in levels:
      lvl_name = level.Name
      lvl_id = level.Id.ToString()
      if lvl_id in target_levels:
        level_names.append(level)
  return level_names

@transaction
def start():
  base_levels = UnwrapElement(IN[0])
  target_levels = UnwrapElement(IN[1])

  # level_printer()

  levels = level_sort(target_levels)
  for i in levels:
    print(i.Id.ToString())

start()

OUT = output.getvalue()
# ----------------------------------------
watch_2 = Watch(python_script_2)
level_printer = Python()  # CPython3; unwired: IN[0]
# ---------- level_printer.python (53 lines) ----------
import clr
import math
from io import StringIO

import Autodesk
import RevitServices
from Autodesk.Revit.DB import *
from Autodesk.Revit.DB import FilteredElementCollector, Dimension

from RevitServices.Persistence import DocumentManager
from RevitServices.Transactions import TransactionManager
from Autodesk.Revit.DB import Dimension, Line, XYZ

clr.AddReference("RevitAPI")
clr.AddReference("RevitServices")


# For Outputting print to watch node
output = StringIO()
sys.stdout = output

doc = DocumentManager.Instance.CurrentDBDocument

def transaction(func):
    def wrapper(*args, **kwargs):
            TransactionManager.Instance.EnsureInTransaction(doc)
            func(*args, **kwargs)
            TransactionManager.Instance.TransactionTaskDone()
    return wrapper
 
def print_member(obj):
  for i in dir(obj):
      print(i)


def  level_printer():
  # Get all levels in the document
  collector = FilteredElementCollector(doc).OfClass(Level)
  levels = collector.ToElements()

  for level in levels:
      lvl_name = level.Name
      lvl_id = level.Id.ToString()
      print(f'"{lvl_id}" # {lvl_name}, ')


@transaction
def start():
  level_printer()

start()

OUT = output.getvalue()
# ----------------------------------------
watch_3 = Watch(level_printer)
